# Grasshopper definition Example for AtchiVision.gh (Grasshopper 1.0.7)
# plug-ins: ArchiVision

切割物件深度 = Slider(65, range=0..100)
切割物件高度 = Slider(10, range=0..100)
切割物件宽度 = Slider(10, range=0..10)
旋转角度 = Slider(22.5, range=0..90)
neg = Negative(Value=切割物件深度)
物件锥形化比率 = Slider(0.59, range=0.4..1)
倾斜 = Slider(0.094, range=0..1)
Y = UnitY(Factor=[切割物件深度, neg])
# Please watch the State under  Solution menu!
Z = UnitZ(Factor=切割物件高度)
neg_2 = Negative(Value=切割物件宽度)
xz = XZPlane(Origin=Y)
dom = ConstructDomain(DomainStart=neg_2, DomainEnd=切割物件宽度)
addition = Addition(A=Z, B=Y)
xz_2 = XZPlane(Origin=Point(0, 0, 0))
rectangle = Rectangle(Plane=xz, XSize=dom, YSize=切割物件高度, Radius=0)  # -> Rectangle, Length
rotate = Rotate(Angle=degrees(旋转角度), Plane=PlaneXY(0, 0, 0))  # -> Geometry, Transform
shear = ShearAngle(Base=xz_2, AngleX=倾斜, AngleY=0)  # -> Geometry, Transform
division = Division(A="1", B=物件锥形化比率)
scale = Scale(Geometry=rectangle.Rectangle, Center=xz, Factor=[division, 物件锥形化比率])  # -> Geometry, Transform
loft = Loft(Curves=scale.Geometry, Options={Adjust=False, Closed=False, LoftEnds=0, LoftSimp=0, LoftType=0, Rebuild=10, Refit=0.01})
transform = Transform(Geometry=addition, Transform=scale.Transform)
comp = Compound(Transforms=[shear.Transform, rotate.Transform])
box = CenterBox(Base=PlaneXY(0, 0, 0), X=24, Y=40, Z=0)
list = ValueList({"Continuous": -1, "Hidden": 0, "Dashed": 1, "DashDot": 2, "Center": 3, "Border": 4, "Dots": 5}, selected="Dashed")
boxrec = BoxRectangle(Rectangle=box, Height=Domain(0, 20))
箭头长 = Slider(10, range=0..10)
cap = CapHoles(Brep=loft)
transform_2 = Transform(Geometry=transform, Transform=comp)
transform_3 = Transform(Geometry=cap, Transform=comp)
Z_2 = UnitZ(Factor=3)
被切割物件 = Brep(boxrec)
箭头起始点 = Point(transform_2)
nickname = CurveDisplayAttribute(Colour=ColourSwatch(SwatchColor=RGB(0, 0, 0)), Thickness=4, LineType=-1, TopMost=False)
切割用物件 = Brep(transform_3)
nickname_2 = CurveDisplayAttribute(Colour=ColourSwatch(SwatchColor=RGB(0, 0, 0)), Thickness=6, LineType=list, TopMost=True)
addition_2 = Addition(A=Z_2, B=箭头起始点)
nickname_3 = CurveDisplayAttribute(Colour=RGB(0, 0, 0), Thickness=5, LineType=-1, TopMost=True)
line = LineSDL(Start=addition_2, Direction=Vector(0, 0, 1), Length=箭头长)
s_di = ShaderDisplayItem(
    Mesh=切割用物件,
    Material={diffuse=RGB(225, 235, 178), emission=RGB(68, 70, 53), shine=0.5, specular=RGB(255, 255, 255), transparency=0},
    AngleLimit=0.5235987756,
    OutLineAttribute=nickname,
    TopMost=True)
s_di_2 = ShaderDisplayItem(Mesh=被切割物件, AngleLimit=0.5235987756, OutLineAttribute=nickname_2, TopMost=False)
preview = CustomPreview(
    Geometry=[被切割物件, 切割用物件],
    Material={diffuse=RGB(221, 160, 221), emission=RGB(66, 48, 66), shine=0.5, specular=RGB(255, 255, 255), transparency=0})
panel = Panel("""-1
2""")
crv_di = CurveDisplayItem(Curve=line, CurveRenderAttribute=nickname_3, StartArrow=panel, EndArrow=reverse(panel), ArrowMult=10)
c_script = CSharpScript(x=crv_di)  # -> out, A
# ---------- c_script: C# usings ----------
using Grasshopper.Kernel.Undo.Actions;
using System.Reflection;
# ---------- c_script: C# ----------
    //A = this.Component.Params.Input[0].Sources[0].GetType();
# ---------- end c_script ----------
panel_2 = Panel(c_script.A)
