# Grasshopper definition Test for ArchiVision.gh (Grasshopper 1.0.7)
# plug-ins: ArchiVision

line = Line(Line((-5.053188591, -28.02991289, -5.951452729), (-5.053188591, -20.07361128, -5.951452729)))
box = DomainBox(Base=PlaneXY(0, 0, 0), X=Domain(-10, 10), Y=Domain(-10, 10), Z=Domain(-10, 10))
box_2 = DomainBox(Base=PlaneXY(0, 0, 0), X=Domain(-10, 0), Y=Domain(-10, 0), Z=Domain(-10, 0))
nickname = CurveDisplayAttribute(Colour=RGB(196, 95, 0), Thickness=Slider(4, range=0..10), LineType=-1, TopMost=False)
nickname_2 = CurveDisplayAttribute(Colour=RGB(196, 0, 0), Thickness=Slider(5, range=0..10), LineType=2, TopMost=True)
nickname_3 = CurveDisplayAttribute(Colour=RGB(196, 0, 0), Thickness=Slider(9, range=0..10), LineType=-1, TopMost=False)
nickname_4 = CurveDisplayAttribute(Colour=RGB(255, 0, 0), Thickness=Slider(5, range=0..10), LineType=-1, TopMost=False)
sdiff = SolidDifference(BrepsA=box, BrepsB=box_2)
s_ri = ShaderRenderItem(
    Mesh=sdiff,
    Material={diffuse=RGB(255, 255, 255), emission=RGB(76, 76, 76), shine=0.5, specular=RGB(255, 255, 255), transparency=0},
    AngleLimit=0.5235987756,
    SharpEdgeAttribute=nickname,
    TopMost=False)
s_ri_2 = ShaderRenderItem(
    Mesh=box_2,
    Material={diffuse=RGB(255, 255, 255), emission=RGB(76, 76, 76), shine=0.5, specular=RGB(255, 255, 255), transparency=1},
    AngleLimit=0.5235987756,
    SharpEdgeAttribute=nickname_2,
    TopMost=False)
debrep = DeconstructBrep(Brep=box)  # -> Faces, Edges, Vertices
crv_ri = CurveRenderItem(Curve=line, CurveRenderAttribute=nickname_4, StartArrow=0, EndArrow=2, ArrowMult=10)
ms_ri = MergedShaderRenderItem(RenderItem=[s_ri, s_ri_2], OutLineAttribute=nickname_3)
pt_di = PointDisplayItem(Point=debrep.Vertices, Colour=RGB(86, 103, 125), Radius=15, Type=4, TopMost=True)
